# Grasshopper definition coinbanksafe.gh (Grasshopper 1.0.7)

crv = Curve([<curve referenced from the Rhino model> x50])
boundary = BoundarySurfaces(Edges=crv)
Z = UnitZ(Factor=Slider(1, range=0..1))
extr = Extrude(Base=boundary, Direction=Z)
